# Grasshopper definition Assignment01_ziqi.gh (Grasshopper 1.0.7)
# plug-ins: Kangaroo2 Components, Karamba3D

curve = Curve(<curve referenced from the Rhino model>)  # disabled
geometry = Geometry(<curve referenced from the Rhino model>)
input_hexagon_0_123456 = GetGeometry(geometry, AtLeast=1, AtMost=1, DeleteInput=False, Filter=1074004029)
explode = Explode(Curve=input_hexagon_0_123456, Recursive=Toggle(False))  # -> Segments, Vertices
area = Area(Geometry=input_hexagon_0_123456)  # -> Area, Centroid
list_item = ListItem(List=explode.Vertices, Index=0, Wrap=True)  # -> Item, Item1, Item2, Item3, Item4, Item5
number_slider = Slider(0.8, range=0..1)
point = Point(flatten([area.Centroid, list_item.Item, list_item.Item1, list_item.Item2, list_item.Item3, list_item.Item4, list_item.Item5]))
line = Line(StartPoint=list_item.Item, EndPoint=list_item.Item3)
line_2 = Line(StartPoint=list_item.Item1, EndPoint=list_item.Item4)
line_3 = Line(StartPoint=list_item.Item2, EndPoint=list_item.Item5)
text_tag_3d = TextTag3D(Location=point, Size=number_slider, Justification=7)

B = Slider(0.1, range=0..0.5)
A = Slider(0.7, range=0.5..1)
number_slider_2 = Slider(0.7, range=0.5..1)
C = Slider(0.1, range=0..0.5)
number_slider_3 = Slider(0.1, range=0..0.5)
number_slider_4 = Slider(0.1, range=0..0.5)

# ---- group: RH_OUT: points' ID
point_list = PointList(Points=point, Size=number_slider)

# ---- group: RH_OUT: curve25
curve_2 = Curve(line_2)

# ---- group: RH_OUT: curve14
curve_3 = Curve(line)

# ----
number_slider_5 = Slider(40, range=0..100)

# ---- group: RH_OUT: curve36
curve_4 = Curve(line_3)

# ----
_04_0_5_1 = GetNumber(A, AtLeast=1, AtMost=1, Maximum=1.797693135e+308, Minimum=-1.797693135e+308)
_01_0_5_1 = GetNumber(number_slider_2, AtLeast=1, AtMost=1, Maximum=1.797693135e+308, Minimum=-1.797693135e+308)
_02_0_0_5 = GetNumber(B, AtLeast=1, AtMost=1, Maximum=1.797693135e+308, Minimum=-1.797693135e+308)
_03_0_0_5 = GetNumber(C, AtLeast=1, AtMost=1, Maximum=1.797693135e+308, Minimum=-1.797693135e+308)
_06_0_0_5 = GetNumber(number_slider_4, AtLeast=1, AtMost=1, Maximum=1.797693135e+308, Minimum=-1.797693135e+308)
_05_0_0_5 = GetNumber(number_slider_3, AtLeast=1, AtMost=1, Maximum=1.797693135e+308, Minimum=-1.797693135e+308)
divide_curve = DivideCurve(Curve=curve_3, Count=number_slider_5, Kinks=False)  # -> Points, Tangents, Parameters
divide_curve_2 = DivideCurve(Curve=curve_4, Count=number_slider_5, Kinks=False)  # -> Points, Tangents, Parameters
divide_curve_3 = DivideCurve(Curve=curve_2, Count=number_slider_5, Kinks=False)  # -> Points, Tangents, Parameters
pline = PolyLine(Vertices=divide_curve.Points, Closed=False)
list_item_2 = ListItem(List=divide_curve_2.Points, Index=Slider(0, range=0..10), Wrap=True)
end = EndPoints(Curve=pline)  # -> Start, End
pline_2 = PolyLine(Vertices=divide_curve_3.Points, Closed=False)
pline_3 = PolyLine(Vertices=divide_curve_2.Points, Closed=False)
end_2 = EndPoints(Curve=pline_2)  # -> Start, End
end_3 = EndPoints(Curve=pline_3)  # -> Start, End
number_slider_6 = Slider(92, range=0..610)
number_slider_7 = Slider(92, range=0..610)
number_slider_8 = Slider(92, range=0..610)
vec2pt = Vector2Pt(PointA=end_3.Start, PointB=end_3.End, Unitize=False)  # -> Vector, Length
vec2pt_2 = Vector2Pt(PointA=end_3.End, PointB=end_3.Start, Unitize=False)  # -> Vector, Length
vec2pt_3 = Vector2Pt(PointA=end_2.End, PointB=end_2.Start, Unitize=False)  # -> Vector, Length
vec2pt_4 = Vector2Pt(PointA=end.Start, PointB=end.End, Unitize=False)  # -> Vector, Length
vec2pt_5 = Vector2Pt(PointA=end_2.Start, PointB=end_2.End, Unitize=False)  # -> Vector, Length
vec2pt_6 = Vector2Pt(PointA=end.End, PointB=end.Start, Unitize=False)  # -> Vector, Length
Z = UnitZ(Factor=expr("-x", number_slider_6))
box = CenterBox(Base=PlaneXY(0, 0, 0), X=number_slider_6, Y=number_slider_6, Z=number_slider_6)
box_2 = CenterBox(Base=PlaneXY(0, 0, 0), X=number_slider_7, Y=number_slider_7, Z=number_slider_7)
Z_2 = UnitZ(Factor=expr("-x", number_slider_7))
multiplication = Multiplication(A=vec2pt_3.Vector, B=_05_0_0_5)
multiplication_2 = Multiplication(A=vec2pt.Vector, B=_03_0_0_5)
multiplication_3 = Multiplication(A=vec2pt_2.Vector, B=_06_0_0_5)
multiplication_4 = Multiplication(A=vec2pt_5.Vector, B=_02_0_0_5)
box_3 = CenterBox(Base=PlaneXY(0, 0, 0), X=number_slider_8, Y=number_slider_8, Z=number_slider_8)
multiplication_5 = Multiplication(A=vec2pt_4.Vector, B=_04_0_5_1)
Z_3 = UnitZ(Factor=expr("-x", number_slider_8))
multiplication_6 = Multiplication(A=vec2pt_6.Vector, B=_01_0_5_1)
explode_2 = Explode(Curve=pline, Recursive=True)  # -> Segments, Vertices
move = Move(Geometry=end_3.Start, Motion=multiplication_2)  # -> Geometry, Transform
explode_3 = Explode(Curve=pline_2, Recursive=True)  # -> Segments, Vertices
move_2 = Move(Geometry=box_2, Motion=Z_2)  # -> Geometry, Transform
move_3 = Move(Geometry=end_2.End, Motion=multiplication)  # -> Geometry, Transform
move_4 = Move(Geometry=end.Start, Motion=multiplication_5)  # -> Geometry, Transform
move_5 = Move(Geometry=box, Motion=Z)  # -> Geometry, Transform
move_6 = Move(Geometry=end_2.Start, Motion=multiplication_4)  # -> Geometry, Transform
explode_4 = Explode(Curve=pline_3, Recursive=True)  # -> Segments, Vertices
move_7 = Move(Geometry=end.End, Motion=multiplication_6)  # -> Geometry, Transform
move_8 = Move(Geometry=box_3, Motion=Z_3)  # -> Geometry, Transform
move_9 = Move(Geometry=end_3.End, Motion=multiplication_3)  # -> Geometry, Transform
rod = Rod(Polyline=pline_2, LengthFactor=1, AngleFactor=1, AxialStrength=10, BendStrength=1)
length_line = LengthLine(Line=pline_2, Strength=10)
load = Load(Point=[end_2.Start, end_2.End], ForceVector=Vector(0, 0, 1), Weighting=1)
spc = SolidPointCollide(Points=explode_3.Vertices, Solid=move_2.Geometry, Interior=False, Unidirectional=True, Strength=1)
anchor = Anchor(Point=end_2.End, Target=move_3.Geometry, Strength=10000)
rod_2 = Rod(Polyline=pline_3, LengthFactor=1, AngleFactor=1, AxialStrength=10, BendStrength=1)
anchor_2 = Anchor(Point=end.End, Target=move_7.Geometry, Strength=10000)
anchor_3 = Anchor(Point=end_2.Start, Target=move_6.Geometry, Strength=10000)
anchor_4 = Anchor(Point=end_3.Start, Target=move.Geometry, Strength=10000)
length_line_2 = LengthLine(Line=pline, Strength=10)
anchor_5 = Anchor(Point=end.Start, Target=move_4.Geometry, Strength=10000)
length_line_3 = LengthLine(Line=pline_3, Strength=10)
anchor_6 = Anchor(Point=end_3.End, Target=move_9.Geometry, Strength=10000)
load_2 = Load(Point=[end_3.Start, end_3.End], ForceVector=Vector(0, 0, 1), Weighting=1)
spc_2 = SolidPointCollide(Points=explode_4.Vertices, Solid=move_8.Geometry, Interior=False, Unidirectional=True, Strength=1)
rod_3 = Rod(Polyline=pline, LengthFactor=1, AngleFactor=1, AxialStrength=10, BendStrength=1)
spc_3 = SolidPointCollide(Points=explode_2.Vertices, Solid=move_5.Geometry, Interior=False, Unidirectional=True, Strength=1)
merge = Merge(Data1=anchor_3, Data2=anchor, Data3=load, Data4=length_line, Data5=rod, Data6=spc)
merge_2 = Merge(Data1=anchor_4, Data2=anchor_6, Data3=load_2, Data4=length_line_3, Data5=rod_2, Data6=spc_2)
merge_3 = Merge(Data1=anchor_5, Data2=anchor_2, Data3=length_line_2, Data4=rod_3, Data5=spc_3)
zombiesolver = ZombieSolver(GoalObjects=[merge_3, merge, merge_2], Threshold=1e-10, Tolerance=0.0001, MaxIterations=50000)  # -> I, V, O
panel = Panel("""2
7
12""")
curve_5 = Curve(zombiesolver.O)
point_2 = Point(zombiesolver.V)
cull_index = CullIndex(List=curve_5, Indices=panel, Wrap=True)
clean_tree = CleanTree(RemoveNulls=True, RemoveInvalid=True, RemoveEmpty=False, Tree=cull_index)
list_length = ListLength(List=clean_tree)
division = Division(A=list_length, B=Slider(3, range=0..10))
number_slider_9 = Slider(21, range=0..21)
number_slider_10 = Slider(21, range=0..21)
number_slider_11 = Slider(21, range=0..21)
integer = Integer(division)
partition_list = PartitionList(List=clean_tree, Size=integer)
explode_tree = ExplodeTree(Data=partition_list)  # -> _000000, _000001, _000002
end_points = EndPoints(Curve=explode_tree._000000)  # -> Start, End
end_points_2 = EndPoints(Curve=explode_tree._000001)  # -> Start, End
end_points_3 = EndPoints(Curve=explode_tree._000002)  # -> Start, End
remove_duplicate_points_karamba3d = RemoveDuplicatePointsKaramba3D(Point=[end_points.Start, end_points.End], LimitDistance=0.005)  # -> OutPoint, Info, Indexes

list_length_2 = ListLength(List=remove_duplicate_points_karamba3d.OutPoint)
division_2 = Division(A=list_length_2, B=Slider(2, range=0..10))
subtraction = Subtraction(A=division_2, B=Slider(1, range=0..1))
split_list = SplitList(List=remove_duplicate_points_karamba3d.OutPoint, Index=subtraction)  # -> ListA, ListB
point_3 = Point(split_list.ListB)

remove_duplicate_points_karamba3d_2 = RemoveDuplicatePointsKaramba3D(Point=[end_points_2.Start, end_points_2.End], LimitDistance=0.005)  # -> OutPoint, Info, Indexes

list_length_3 = ListLength(List=remove_duplicate_points_karamba3d_2.OutPoint)
division_3 = Division(A=list_length_3, B=Slider(2, range=0..10))
subtraction_2 = Subtraction(A=division_3, B=Slider(1, range=0..1))
split_list_2 = SplitList(List=remove_duplicate_points_karamba3d_2.OutPoint, Index=subtraction_2)  # -> ListA, ListB
point_4 = Point(split_list_2.ListB)

remove_duplicate_points_karamba3d_3 = RemoveDuplicatePointsKaramba3D(Point=[end_points_3.Start, end_points_3.End], LimitDistance=0.005)  # -> OutPoint, Info, Indexes

list_length_4 = ListLength(List=remove_duplicate_points_karamba3d_3.OutPoint)
division_4 = Division(A=list_length_4, B=Slider(2, range=0..10))
subtraction_3 = Subtraction(A=division_4, B=Slider(1, range=0..1))
split_list_3 = SplitList(List=remove_duplicate_points_karamba3d_3.OutPoint, Index=subtraction_3)  # -> ListA, ListB
point_5 = Point(split_list_3.ListB)

split_list_4 = SplitList(List=split_list.ListA, Index=number_slider_9)  # -> ListA, ListB
split_list_5 = SplitList(List=point_3, Index=Slider(1, range=0..100))  # -> ListA, ListB
split_list_6 = SplitList(List=split_list_2.ListA, Index=number_slider_10)  # -> ListA, ListB
split_list_7 = SplitList(List=split_list_3.ListA, Index=number_slider_11)  # -> ListA, ListB
split_list_8 = SplitList(List=point_4, Index=Slider(1, range=0..100))  # -> ListA, ListB
split_list_9 = SplitList(List=split_list_5.ListB, Index=number_slider_9)  # -> ListA, ListB
point_list_2 = PointList(Points=split_list_4.ListA, Size=Slider(0.2, range=0..1))
split_list_10 = SplitList(List=point_5, Index=Slider(1, range=0..100))  # -> ListA, ListB
split_list_11 = SplitList(List=split_list_10.ListB, Index=number_slider_11)  # -> ListA, ListB
split_list_12 = SplitList(List=split_list_8.ListB, Index=number_slider_10)  # -> ListA, ListB
point_list_3 = PointList(Points=split_list_9.ListA, Size=Slider(0.2, range=0..1))
point_list_4 = PointList(Points=split_list_12.ListA, Size=Slider(0.2, range=0..1))
point_list_5 = PointList(Points=split_list_11.ListA, Size=Slider(0.2, range=0..1))
point_list_6 = PointList(Points=split_list_6.ListA, Size=Slider(0.2, range=0..1))
point_list_7 = PointList(Points=split_list_7.ListA, Size=Slider(0.2, range=0..1))
reverse_list = ReverseList(List=split_list_3.ListA)
reverse_list_2 = ReverseList(List=split_list_10.ListB)
list_item_3 = ListItem(List=split_list_4.ListA, Index=0, Wrap=True)
list_item_4 = ListItem(List=split_list_9.ListA, Index="19", Wrap=True)
list_item_5 = ListItem(List=split_list_6.ListA, Index=0, Wrap=True)
list_item_6 = ListItem(List=split_list_12.ListA, Index="19", Wrap=True)
list_item_7 = ListItem(List=split_list_7.ListA, Index=0, Wrap=True)
list_item_8 = ListItem(List=split_list_11.ListA, Index="19", Wrap=True)
loft = Loft(
    Curves=[explode_tree._000000, explode_tree._000001, explode_tree._000002],
    Options={Adjust=False, Closed=False, LoftEnds=0, LoftSimp=0, LoftType=0, Rebuild=10, Refit=0.01})
line_4 = Line(StartPoint=list_item_6, EndPoint=list_item_8)
line_5 = Line(StartPoint=list_item_3, EndPoint=list_item_6)
line_6 = Line(StartPoint=list_item_8, EndPoint=list_item_4)
line_7 = Line(StartPoint=list_item_5, EndPoint=list_item_7)
line_8 = Line(StartPoint=list_item_7, EndPoint=list_item_3)
line_9 = Line(StartPoint=list_item_4, EndPoint=list_item_5)
line_10 = Line(StartPoint=reverse_list, EndPoint=split_list.ListA)
line_11 = Line(StartPoint=split_list_5.ListB, EndPoint=reverse_list_2)
line_12 = Line(StartPoint=split_list_5.ListB, EndPoint=split_list_2.ListA)
bounding_box = BoundingBox(Content=loft, Plane=PlaneXY(0, 0, 0))  # -> Box, Box_2
line_13 = Line(StartPoint=list_item_3, EndPoint=list_item_4)
line_14 = Line(StartPoint=list_item_5, EndPoint=list_item_6)
line_15 = Line(StartPoint=split_list_8.ListB, EndPoint=reverse_list_2)
line_16 = Line(StartPoint=reverse_list, EndPoint=split_list_2.ListA)
line_17 = Line(StartPoint=split_list_8.ListB, EndPoint=split_list.ListA)
line_18 = Line(StartPoint=list_item_7, EndPoint=list_item_8)
boundary_surfaces = BoundarySurfaces(Edges=flatten([line_5, line_4, line_6, line_9, line_7, line_8]))
curve_6 = Curve([line_5, line_4, line_6, line_9, line_7, line_8])
length = Length(Curve=line_10)
explode_tree_2 = ExplodeTree(Data=bounding_box.Box)  # -> _0000000, _0000010, _0000020
length_2 = Length(Curve=line_11)
length_3 = Length(Curve=line_13)
length_4 = Length(Curve=line_12)
length_5 = Length(Curve=line_14)
length_6 = Length(Curve=line_17)
length_7 = Length(Curve=line_18)
length_8 = Length(Curve=line_15)
length_9 = Length(Curve=line_16)
custom_preview = CustomPreview(Geometry=boundary_surfaces, Material=ColourSwatch(SwatchColor=RGBA(35, 57, 61, 97)))
area_2 = Area(Geometry=boundary_surfaces)  # -> Area, Centroid
panel_2 = Panel(length_5)
mass_addition = MassAddition(Input=length_2)  # -> Result, PartialResults
mass_addition_2 = MassAddition(Input=length_4)  # -> Result, PartialResults
mass_addition_3 = MassAddition(Input=length)  # -> Result, PartialResults
brep = Brep(explode_tree_2._0000010)
panel_3 = Panel(length_7)
custom_preview_2 = CustomPreview(Geometry=curve_6, Material=ColourSwatch(SwatchColor=RGBA(35, 57, 61, 0)))

# ---- group: 直径
panel_4 = Panel(length_3)

# ----
mass_addition_4 = MassAddition(Input=length_6)  # -> Result, PartialResults
mass_addition_5 = MassAddition(Input=length_8)  # -> Result, PartialResults
mass_addition_6 = MassAddition(Input=length_9)  # -> Result, PartialResults
deconstruct_brep = DeconstructBrep(Brep=brep)  # -> Faces, Edges, Vertices

# ---- group: RH_OUT: area boundry
curve_7 = Curve(curve_6)

# ----
list_item_9 = ListItem(List=deconstruct_brep.Edges, Index=Slider(11, range=0..12), Wrap=True)
curve_8 = Curve(list_item_9)
mass_addition_7 = MassAddition(Input=flatten([mass_addition_3.Result, mass_addition.Result, mass_addition_2.Result, mass_addition_4.Result, mass_addition_6.Result, mass_addition_5.Result]))  # -> Result, PartialResults
length_10 = Length(Curve=curve_8)
number = Number(flatten(mass_addition_7.Result))
entwine = Entwine(
    Branch00=clean_tree,
    Branch01=line_10,
    Branch02=line_11,
    Branch03=line_12,
    Branch04=line_17,
    Branch05=line_16,
    Branch06=line_15,
    FlattenInputs=True)

# ---- group: area(m^2)
panel_5 = Panel(area_2.Area)

# ---- group: height(m)
height = Panel(length_10)

# ----
geometry_2 = Geometry(entwine)

# ---- group: total material usage(m)
panel_6 = Panel(mass_addition_7.Result)

# ---- group: AOC
panel_7 = Panel(mass_addition_3.Result)

# ---- group: A'OC'
panel_8 = Panel(mass_addition.Result)

# ---- group: BOC
panel_9 = Panel(mass_addition_6.Result)

# ---- group: AOB'
panel_10 = Panel(mass_addition_4.Result)

# ---- group: A'OB
panel_11 = Panel(mass_addition_2.Result)

# ---- group: B'OC'
panel_12 = Panel(mass_addition_5.Result)

# ----
pipe = Pipe(Curve=geometry_2, Radius=Slider(0.01, range=0..0.01), Caps=0)

# ---- group: RH_OUT: form
brep_2 = Brep(pipe)
